# Grasshopper definition urban_massing.ghx (Grasshopper 1.0.7)

# ----
# Data
# Design Parameters
# Setup Dataset
# PerformanceAttributes
# Generate Samples
# Load Dataset
load_dataset = Button()
m = Panel("8 to 49")
datasetgenerator = DatasetGenerator()  # -> instructions
#   port instructions: Information on how to run the `dataset_generator` script.
# ---------- datasetgenerator: Python ----------
"""Provides instructions on how to generate random samples for the dataset."""
from aixd_ara.scripts import dataset_generator

path = dataset_generator.__file__

txt = "INSTRUCTIONS\n------------\n"
txt += "How to generate random samples for a dataset, by harnessing the parametric model defined in this Grasshopper file?\n\n"
txt += "Prepare the inputs and outputs to/from your parametric model as shown in the online documentation>tutorial at https://gramaziokohler.github.io/aixd_ara/latest/tutorial.html\n\n"
txt += "Close all other Grasshopper files in this Rhino app.\n\n"
txt += "Locate the 'dataset_generator.py' file in:\n\n"
txt += "\t{}\n\n".format(path)
txt += "In Rhino, open the Rhino Python Editor, open 'dataset_generator.py' and run it.\n"
txt += "(Follow the prompts in the Rhino command line)\n\n"

txt += "\n------------\n"
txt += "Optionally, add a button to a Rhino toolbar to access the dataset generator more easily:\n"
txt += "\t> right-click on a toolbar > New Button... \n"
txt += "\t> in the pop-up window, in Command section, paste:\n\n"
txt += "\t'! _-RunPythonScript {}'".format(path)

instructions = txt
# ---------- end datasetgenerator ----------
domain = Domain(m)
datasetonesample = DatasetOneSample(get=Button())  # -> sample_summary; inputs item: Int32, get: Boolean
#   port item: Index of the sample in the dataset, optional. If not provided, a random index will be selected.
#   port get: Set to True to retrieve a sample.
#   port sample_summary: Summary of the retrieved sample.
# ---------- datasetonesample: Python ----------
"""Retrieves one sample from the dataset (at a given or random index) and instantiates it in the parametric model. 
Requires a dataset to be loaded."""
# flake8: noqa
from scriptcontext import sticky as st

from aixd_ara.gh_ui import get_one_sample
from aixd_ara.gh_ui_helper import component_id
from aixd_ara.gh_ui_helper import instantiate_sample, sample_summary
from aixd_ara.gh_ui_helper import session_id

cid = component_id(session_id(), ghenv.Component, "DatasetOneSample")


if not item:
    item = -1

if get:
    st[cid] = get_one_sample(session_id(), item)

ghdoc = ghenv.Component.OnPingDocument()


if cid in st.keys():
    sample = st[cid]
    instantiate_sample(ghdoc, sample)

    sample_summary = sample_summary(sample)
# ---------- end datasetonesample ----------
datasetsummary = DatasetSummary(get=Button())  # -> summary; inputs get: Boolean
#   port get: Set to True to get the summary of the dataset.
#   port summary: Summary of the dataset.
# ---------- datasetsummary: Python ----------
"""Provides a summary of the dataset. 
Requires a dataset to be loaded."""
# flake8: noqa
from scriptcontext import sticky as st

from aixd_ara.gh_ui import dataset_summary
from aixd_ara.gh_ui_helper import component_id
from aixd_ara.gh_ui_helper import session_id

cid = component_id(session_id(), ghenv.Component, "DatasetSummary")

if get:
    st[cid] = dataset_summary(session_id())

if cid in st.keys():
    if st[cid]["msg"]:
        summary = st[cid]["msg"]  # error
    else:
        summary = st[cid]["summary"]
# ---------- end datasetsummary ----------
datareal = DataReal(name="heights", dim="8", domain=domain)  # -> dataobject; inputs dim: Int32
#   port name: Name of the variable.
#   port dim: Dimension of the variable.
#   port domain: Domain of the variable as an interval.
# ---------- datareal: Python ----------
"""Defines a real-valued variable."""
# flake8: noqa
from aixd_ara.wrappers import WrapperShallowDataObject

if not dim or dim < 1:
    dim = 1

if domain:
    domain = (float(domain.Min), float(domain.Max))
else:
    domain = None


dobj = {"datatype": "DataReal", "name": name, "dim": dim, "domain": domain}


dataobject = WrapperShallowDataObject(dobj)
# ---------- end datareal ----------
datareal_2 = DataReal(name="volume")  # -> dataobject; inputs dim: Int32; same code as datareal
datareal_3 = DataReal(name="gfa")  # -> dataobject; inputs dim: Int32; same code as datareal
datareal_4 = DataReal(name="sundiff")  # -> dataobject; inputs dim: Int32; same code as datareal
datasetload = DatasetLoad(load=load_dataset)  # -> msg; inputs load: Boolean
#   port load: Set to True to load the dataset.
# ---------- datasetload: Python ----------
"""Loads an existing dataset from the file system, from the location specified in the project setup. It loads the dataset object and the data into the app."""
# flake8: noqa
from scriptcontext import sticky as st

from aixd_ara.gh_ui import load_dataset
from aixd_ara.gh_ui_helper import component_id
from aixd_ara.gh_ui_helper import session_id

cid = component_id(session_id(), ghenv.Component, "DatasetLoad")

if load:
    st[cid] = load_dataset(session_id())

if cid in st.keys():
    msg = st[cid]["msg"]
# ---------- end datasetload ----------
panel = Panel(datasetgenerator)
merge = Merge(Data1=flatten(datareal_2), Data2=flatten(datareal_3), Data3=datareal_4)
panel_2 = Panel(datasetsummary)
panel_3 = Panel(datasetonesample)
panel_4 = Panel(datasetload)
datasetcreate = DatasetCreate(design_parameters=datareal, performance_attributes=merge, create=Button())  # -> msg; inputs design_parameters: list, performance_attributes: list, create: Boolean
#   port design_parameters: Design parameters: list of data objects.
#   port performance_attributes: Performance attributes: list of data objects.
#   port create: Set to True to create a dataset object. If a dataset already exists in the project path, nothing will happen. To create a new dataset, change the project path or dataset name or delete the existing dataset.
#   port msg: Message or error.
# ---------- datasetcreate: Python ----------
"""Creates a dataset object. This defines the structure of the dataset. It does not cointain any data."""
# flake8: noqa
from scriptcontext import sticky as st
from Grasshopper.Kernel.GH_RuntimeMessageLevel import Warning

from aixd_ara.gh_ui import create_dataset_object
from aixd_ara.gh_ui_helper import component_id
from aixd_ara.gh_ui_helper import session_id

cid = component_id(session_id(), ghenv.Component, "DatasetCreate")


design_parameters = [x.data for x in design_parameters]
performance_attributes = [x.data for x in performance_attributes]


if create:
    st[cid] = create_dataset_object(session_id(), design_parameters, performance_attributes)

if cid in st.keys():
    msg = st[cid]["msg"]
    if st[cid]["status"]=="warning":
        ghenv.Component.AddRuntimeMessage(Warning, msg)
# ---------- end datasetcreate ----------
panel_5 = Panel(datasetcreate)
dataobjectsnames = DataObjectsNames(get_names=Button())  # inputs get_names: Boolean
#   port get_names: Set to True to run.
# ---------- dataobjectsnames: Python ----------
"""Generates panels with list of names of data objects for all existing data blocks."""
# flake8: noqa

# this code has been inspired by a forum post by "chanley" (2018.11.02)
# https://discourse.mcneel.com/t/can-i-instantiate-specific-component-on-the-canvas-with-a-script-python/74204/8

import Grasshopper
import System.Drawing as sd

from aixd_ara.gh_ui import get_dataobject_names_from_block
from aixd_ara.gh_ui_helper import session_id

comp = ghenv.Component
ghdoc = comp.OnPingDocument()


def make_Panel(NickName, UserText, Pivot, Bounds):
    try:
        Panel = Grasshopper.Kernel.Special.GH_Panel()
        Panel.NickName = NickName
        Panel.UserText = UserText
        Panel.Properties.Colour = sd.Color.White
        # Panel.Properties.Font = sd.Font("Trebuchet MS", 10)
        Panel.Properties.Multiline = False
        Panel.Properties.DrawIndices = False
        Panel.Properties.DrawPaths = False
        ghdoc.AddObject(Panel, False, ghdoc.ObjectCount + 1)
        Panel.Attributes.Pivot = Pivot
        Panel.Attributes.Bounds = Bounds
    except Exception(ex):
        ghenv.Component.AddRuntimeMessage(Grasshopper.Kernel.GH_RuntimeMessageLevel.Warning, str(ex))


x = ghenv.Component.Attributes.DocObject.Attributes.Bounds.Right
y = ghenv.Component.Attributes.DocObject.Attributes.Bounds.Top

w = 150
h = 150
gap = 50

errors = ""

datablocks = ["design_parameters", "performance_attributes", "inputML", "outputML"]  # all datablock names

if get_names:

    for i, datablock_nickname in enumerate(datablocks):
        panel_title = datablock_nickname
        response = get_dataobject_names_from_block(session_id(), datablock_nickname)
        text_items = response["names"]
        if text_items:
            text_str = "\n".join(text_items)
            pt = sd.PointF(x + gap + i * gap, y + i * gap)
            rect = sd.RectangleF(0, 0, w, h)
            make_Panel(panel_title, text_str, pt, rect)
        else:
            errors += response["msg"] + "\n"

if errors:
    ghenv.Component.AddRuntimeMessage(Grasshopper.Kernel.GH_RuntimeMessageLevel.Warning, str(errors))
# ---------- end dataobjectsnames ----------

# ----
# Parametric Model
building_outline_curves = Curve([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])
dp_heights = Number([47.90690418, 34.12594065, 35.61458411, 43.67723225, 43.82217533, 28.24180827, 44.90806632, 21.63576985])
# Author: Aleksandra Anna Apolinarska (ETH Zurich, 2024)
# 
# Many thanks to Alejandro Fuentes (KCAP / TU Delft) suggesting the application for urban massing studies!
# 
# Using snippets from: https://github.com/ladybug-tools/lbt-grasshopper-samples/blob/master/samples/ladybug/direct_sun_study.gh
# 
# Additional Dependencies:
# * Ladybug
genes = GenePool(
    Decimals=4,
    Maximum=42,
    Minimum=7,
    Value=[30.60913709, 32.8079872, 24.46971576, 26.6742, 23.917, 13.00210486, 29.51756928, 13.65490856])
cluster = Cluster(heights=dp_heights, outlines=building_outline_curves)  # -> floor_outlines_2, building_breps_2, mesh_4, volume_m3_2, gfa_m2_2, directsunhoursdifference_2
brep = Brep(cluster.building_breps_2)
mesh = Mesh(cluster.mesh_4)
pa_gfa = Number(cluster.gfa_m2_2)
pa_sundiff = Number(cluster.directsunhoursdifference_2)
pa_volume = Number(cluster.volume_m3_2)
crv = Curve(cluster.floor_outlines_2)
preview = CustomPreview(Geometry=crv, Material=ColourSwatch(SwatchColor=RGB(227, 190, 152)))
preview_2 = CustomPreview(Geometry=brep, Material=ColourSwatch(SwatchColor=RGB(232, 217, 193)))
gross_floor_area_m2 = Panel(pa_gfa)
hours_less_direct_sunlight = Panel(pa_sundiff)
volume_m3 = Panel(pa_volume)

# ----
# Plotters
performance_attributes = Panel("""heights
volume
gfa
sundiff""")
variables = Panel("""gfa
sundiff""")
variables_2 = Panel("heights")
plotcorrelations = PlotCorrelations(variables=performance_attributes, plot=Button())  # inputs variables: list, plot: Boolean
#   port variables: List of names of the variables to be plotted.
#   port plot: Set to True to (re-)create the plot.
# ---------- plotcorrelations: Python ----------
"""Plots correlation matrix for the given variables from the data in the dataset."""
# flake8: noqa
from scriptcontext import sticky as st

from aixd_ara.gh_ui import plot_correlations
from aixd_ara.gh_ui_helper import component_id
from aixd_ara.gh_ui_helper import convert_str_to_bitmap
from aixd_ara.gh_ui_helper import session_id

cid = component_id(session_id(), ghenv.Component, "PlotCorrelations")


if plot:
    st[cid] = plot_correlations(session_id(), variables, "interactive")  # will launch the plotly fig in browser

if cid in st.keys():
    print(st[cid])
# ---------- end plotcorrelations ----------
plotdistribution = PlotDistribution(variables=variables_2, plot=Button())  # inputs variables: list, plot: Boolean
#   port variables: List of names of the variables to be plotted.
#   port plot: Set to True to (re-)create the plot.
# ---------- plotdistribution: Python ----------
"""Plots the distribution of the given variables from the data in the dataset."""
# flake8: noqa
from scriptcontext import sticky as st

from aixd_ara.gh_ui import plot_distrib_attributes
from aixd_ara.gh_ui_helper import component_id
from aixd_ara.gh_ui_helper import convert_str_to_bitmap
from aixd_ara.gh_ui_helper import session_id

cid = component_id(session_id(), ghenv.Component, "PlotDistributions")


if plot:
    st[cid] = plot_distrib_attributes(session_id(), variables, "interactive") #  will launch the plotly fig in browser

if cid in st.keys():
    print(st[cid])
# ---------- end plotdistribution ----------
plotcontours = PlotContours(variables=performance_attributes, plot=Button())  # inputs variables: list, plot: Boolean
#   port variables: List of names of the variables to be plotted.
#   port plot: Set to True to (re-)create the plot.
# ---------- plotcontours: Python ----------
"""Plots the distribution contours for each pair of variables from the data in the dataset."""
# flake8: noqa
from scriptcontext import sticky as st

from aixd_ara.gh_ui import plot_contours
from aixd_ara.gh_ui_helper import component_id
from aixd_ara.gh_ui_helper import convert_str_to_bitmap
from aixd_ara.gh_ui_helper import session_id

cid = component_id(session_id(), ghenv.Component, "PlotContours")


if plot:
    st[cid] = plot_contours(session_id(), variables, "interactive") # will launch the plotly fig in browser

if cid in st.keys():
    print st[cid]
# ---------- end plotcontours ----------
plotcontoursrequest = PlotContoursRequest(plot=Button())  # inputs plot: Boolean
#   port plot: Set to True to (re-)create the plot.
# ---------- plotcontoursrequest: Python ----------
"""Plots the predicted values of the requested designs against the distribution contours for each pair of the corresponding variables."""
# flake8: noqa
from scriptcontext import sticky as st
from aixd_ara.gh_ui import plot_contours_request
from aixd_ara.gh_ui import get_dataobject_types
from aixd_ara.gh_ui_helper import session_id
from aixd_ara.gh_ui_helper import component_id
from aixd_ara.gh_ui_helper import convert_str_to_bitmap
from aixd_ara.gh_ui_helper import reformat_request


cid = component_id(session_id, ghenv.Component, "PlotContoursRequest")


if plot:
    st[cid] = plot_contours_request(session_id(), "interactive") # will launch the plotly fig in browser

if cid in st.keys():
    print st[cid]
# ---------- end plotcontoursrequest ----------

# ----
# Project Setup
panel_6 = Panel("urban_massing_dataset")
server = Server(start=Button(), show_window=Toggle(True))  # -> msg; inputs start: Boolean, stop: Boolean, show_window: Boolean
#   port start: Starts the server.
# ---------- server: Python ----------
from __future__ import absolute_import
from __future__ import division
from __future__ import print_function

import urllib2

import compas
import compas._os
from ghpythonlib.componentbase import executingcomponent as component
from scriptcontext import sticky as st

from aixd_ara.constants import DEFAULT_PORT

try:
    from subprocess import PIPE
    from subprocess import Popen
except ImportError:
    from System.Diagnostics import Process

import os

import aixd_ara as ag


class ApiRunner(object):
    def __init__(
        self,
        package=None,
        python=None,
        url="http://127.0.0.1",
        port=DEFAULT_PORT,
        service=None,
        max_conn_attempts=100,
        autoreload=True,
        show_window=False,
        path=None,
        working_directory=None,
    ):
        self.python = compas._os.select_python(python)
        self.service = "aixd_ara.api"
        self.working_directory = working_directory
        self.show_window = show_window
        self.port = port

        self.start_process()

    def start_process(self):
        env = compas._os.prepare_environment()

        try:
            Popen
        except NameError:
            self._process = Process()
            for name in env:
                if self._process.StartInfo.EnvironmentVariables.ContainsKey(name):
                    self._process.StartInfo.EnvironmentVariables[name] = env[name]
                else:
                    self._process.StartInfo.EnvironmentVariables.Add(name, env[name])
            self._process.StartInfo.UseShellExecute = True
            self._process.StartInfo.RedirectStandardOutput = not self.show_window
            self._process.StartInfo.RedirectStandardError = not self.show_window
            self._process.StartInfo.FileName = self.python
            self._process.StartInfo.Arguments = "-m {0} {1}".format(self.service, self.port)
            self._process.Start()
        else:
            args = [self.python, "-m", self.service, str(self.port)]
            kwargs = dict(env=env)

            if self.show_window:
                if compas.is_mono():
                    python_command = " ".join(args)
                    apple_script = """
                    tell application "Terminal"
                        do script "{}"
                        activate
                    end tell
                    """.format(
                        python_command
                    )
                    args = ["osascript", "-e", apple_script]
            else:
                kwargs["stdout"] = PIPE
                kwargs["stderr"] = PIPE

            if self.working_directory:
                kwargs["cwd"] = self.working_directory
            self._process = Popen(args, **kwargs)

    def stop_process(self):
        """Attempts to terminate the python process hosting the proxy server.

        The process reference might not be present, e.g. in the case
        of reusing an existing connection. In that case, this is a no-op.
        """
        print("Stopping the server process.")

        if not self._process:
            return

        try:
            self._process.terminate()
        except Exception:
            pass
        try:
            self._process.kill()
        except Exception:
            pass


api_path = os.path.dirname(ag.__file__)

print(api_path)


def create_api_runner_id(component):
    name = "api-runner"
    return "{}_{}".format(name, component.InstanceGuid)


class ApiRunnerComponent(component):

    def RunScript(self, start, stop, show_window=True):
        key = create_api_runner_id(self)
        port = DEFAULT_PORT

        if show_window:
            python = "python"
        else:
            python = "pythonw"

        if start:
            self.stop(key)
            runner = ApiRunner(python=python, port=port, show_window=show_window, working_directory=api_path)
            st[key] = runner

        if stop:
            self.stop(key)

    def stop(self, key):
        # Attempt gracefully stopping the server
        try:
            urllib2.urlopen("http://127.0.0.1:8765/shutdown", timeout=1)
        except Exception:
            pass

        # stop previous API runner if any
        previous_api_runner = st.get(key)
        if previous_api_runner:
            try:
                previous_api_runner.stop_process()
            except Exception as e:
                print("Unable to stop previous process")
                print(e)
            st.pop(key)
        else:
            print("No previous process runner found")
# ---------- end server ----------
reset = Reset(reset=Button())  # inputs reset: Boolean
#   port reset: Set to True to reset.
# ---------- reset: Python ----------
"""Resets the current project running in this Grasshopper file."""
# flake8: noqa

from scriptcontext import sticky as st
from aixd_ara.gh_ui import reset_session
from aixd_ara.gh_ui_helper import session_id, clear_sticky

if reset:
    reset_session(session_id())
    clear_sticky(ghenv, st)
# ---------- end reset ----------
projectsetup = ProjectSetup(set=Button(), project_name=panel_6)  # -> msg, path; inputs set: Boolean
#   port project_root: Path to the project root folder. If none is given, the default is the parent folder of this Grasshopper file.
#   port project_name: Any name for the project. It will be used to create a folder with the same name in the project root folder. All files will be later saved here.
#   port msg: Messages and errors.
#   port path: Effective path to the project.
# ---------- projectsetup: Python ----------
"""Sets up the project in the folder given by `project_root/project_name`."""
# flake8: noqa
import os

from scriptcontext import sticky as st

from aixd_ara.gh_ui import project_setup
from aixd_ara.gh_ui_helper import clear_sticky
from aixd_ara.gh_ui_helper import component_id
from aixd_ara.gh_ui_helper import session_id

if not project_root:
    ghdoc = ghenv.Component.OnPingDocument().FilePath
    project_root = os.path.dirname(ghdoc)

if project_name:
    cid = component_id(session_id(), ghenv.Component, "ProjectSetup")

    if set:
        complete_path = os.path.join(project_root, project_name)
        if not os.path.exists(complete_path):
            print("The path {} does not exist and will be now created.".format(complete_path))
            os.mkdir(complete_path)

        clear_sticky(ghenv, st)

        st[cid] = project_setup(session_id(), project_root, project_name)

    if cid in st.keys():
        msg = st[cid]["msg"]
        path = st[cid]["path"]
# ---------- end projectsetup ----------
panel_7 = Panel(projectsetup.msg)
panel_8 = Panel(projectsetup.path)
showfolder = ShowFolder(path=projectsetup.path, open=Button())  # inputs open: Boolean
#   port path: Path to the (local) folder.
#   port open: Set to True to open the folder in the file explorer.
# ---------- showfolder: Python ----------
"""Reveals the folder in the file explorer."""
# flake8: noqa

import compas
import subprocess

if open:
    command = "open"
    if compas.is_windows():
        command = "explorer"

    subprocess.Popen([command, path])
# ---------- end showfolder ----------

# ----
# Autoencoder Model
# set up a new model
# run training
# load a trained model
# model summary
number_slider = Slider(2, range=1..5)
design_parameters = Panel("heights")
performance_attributes_2 = Panel("""volume
gfa
sundiff""")
load_model = Button()
train = Button()
panel_9 = Panel("""16
64
256
256
64
16""")
modelsetup = ModelSetup(
    features=design_parameters,
    targets=performance_attributes_2,
    latent_dim="4",
    hidden_layers=panel_9,
    batch_size="512",
    set=Button())  # -> quick_summary, model_dims; inputs features: list, targets: list, latent_dim: Int32, hidden_layers: list of Int32, batch_size: Int32, set: Boolean
#   port model_type: Type of the autoencoder model. Options are: 'CAE' (conditional Autoencoder) and 'CVAE' (conditional Variational Autoencoder). Default: 'CAE'.
#   port features: List of variable names to be used as input to the model.
#   port targets: List of variable names to be used as output from the model.
#   port latent_dim: Dimension of the latent space.
#   port hidden_layers: Width of each hidden layer (list of int).
#   port batch_size: Size of the training batches
#   port set: Set to True to set up the model.
#   port quick_summary: Quick summary of the model.
#   port model_dims: Input and output dimensions of the model.
# ---------- modelsetup: Python ----------
"""Sets up an autoencoder model of the specified type with the given parameters."""
# flake8: noqa
from scriptcontext import sticky as st

from aixd_ara.gh_ui import model_setup
from aixd_ara.gh_ui_helper import component_id
from aixd_ara.gh_ui_helper import session_id

cid = component_id(session_id(), ghenv.Component, "ModelSetup")

settings = {
    "model_type": model_type,
    "inputML": features,
    "outputML": targets,
    "latent_dim": latent_dim,
    "hidden_layers": hidden_layers,
    "batch_size": batch_size,
}


# TODO: make default settings a bit more smart
default_settings = {
    "model_type": "CAE",
    "inputML": "design_parameters",
    "outputML": "performance_attributes",
    "latent_dim": 8,
    "hidden_layers": [512, 256, 128, 64],
    "batch_size": 16,
}

for k in default_settings.keys():
    if (k not in settings) or (k in settings and settings[k] == None) or (k in settings and settings[k] == []):
        settings[k] = default_settings[k]
        print(k, default_settings[k])


if set:
    st[cid] = model_setup(session_id(), settings)


if cid in st.keys():
    quick_summary = st[cid]["quick_summary"]["summary"]
    model_dims = st[cid]["model_dims"]["summary"]
    ghenv.Component.Message = st[cid]["msg"]
# ---------- end modelsetup ----------
modeltrain = ModelTrain(epochs="100", run=train)  # -> best_ckpt, path; inputs epochs: Int32, run: Boolean
#   port epochs: Number of training epochs.
#   port wb: Weights&Biases: username or team name. If not set, W&B will not be used.
#   port run: Set to True to start training.
#   port best_ckpt: Filename of the best performing checkpoint.
#   port path: Path to all checkpoints.
# ---------- modeltrain: Python ----------
"""Runs a training campaign."""
# flake8: noqa

from scriptcontext import sticky as st

from aixd_ara.gh_ui import model_train
from aixd_ara.gh_ui import project_setup_info
from aixd_ara.gh_ui_helper import component_id
from aixd_ara.gh_ui_helper import session_id

cid = component_id(session_id(), ghenv.Component, "ModelTrain")


if not epochs or epochs < 1:
    epochs = 1

if wb:
    import webbrowser

    if run:
        projectname = project_setup_info(session_id())["project_name"]
        url = "https://wandb.ai/{}/{}".format(wb, projectname)
        webbrowser.open(url)
        # TODO: check login and add interface to login if needed


if run:
    st[cid] = model_train(session_id(), epochs, wb)


if cid in st.keys():
    best_ckpt = st[cid]["best_ckpt"]
    path = st[cid]["path"]
    ghenv.Component.Message = st[cid]["msg"]
else:
    ghenv.Component.Message = ""

# TODO:
# * return path or name of best checkpoint
# * make non-GUI-blocking
# * display progress
# ---------- end modeltrain ----------
modelload = ModelLoad(load=load_model)  # -> msg; inputs load: Boolean
#   port model_type: Type of the autoencoder model. Options are: 'CAE' (conditional Autoencoder) and 'CVAE' (conditional Variational Autoencoder). Default: 'CAE'.
#   port checkpoint_name: Name of the checkpoint file to load the model from, without the file extension. The file's extension must be .ckpt
#   port checkpoint_path: Path to the directory containing the checkpoint file.
#   port load: Set to True to load the model.
#   port msg: Confirmation of the model loading, or an error message.
# ---------- modelload: Python ----------
"""Loads an existing, pre-traind neural network model from a checkpoint."""
# flake8: noqa
from scriptcontext import sticky as st

from aixd_ara.gh_ui import model_load
from aixd_ara.gh_ui_helper import component_id
from aixd_ara.gh_ui_helper import session_id

cid = component_id(session_id(), ghenv.Component, "ModelLoad")

if not model_type:
    model_type = "CAE"
if not checkpoint_path:
    checkpoint_path = ""
if not checkpoint_name:
    checkpoint_name = "last"

if load:
    st[cid] = model_load(session_id(), model_type, checkpoint_name, checkpoint_path)

if cid in st.keys():
    msg = st[cid]["msg"]
# ---------- end modelload ----------
modeldimensions = ModelDimensions(get=Button())  # -> summary; inputs get: Boolean
#   port get: Set to True to retrieve input and output dimensions of the model.
#   port summary: Summary of the model's input and output dimensions.
# ---------- modeldimensions: Python ----------
"""Retrieves dimensions of the model's input and output layers."""
# flake8: noqa
from scriptcontext import sticky as st

from aixd_ara.gh_ui import model_input_output_dimensions
from aixd_ara.gh_ui_helper import component_id
from aixd_ara.gh_ui_helper import session_id

cid = component_id(session_id(), ghenv.Component, "ModelDims")

if get:
    st[cid] = model_input_output_dimensions(session_id())

if cid in st.keys():
    summary = st[cid]["summary"]
# ---------- end modeldimensions ----------
modelsummary = ModelSummary(max_depth=number_slider, get=Button())  # -> summary; inputs max_depth: Int32, get: Boolean
#   port max_depth: Sets the depth of the summary. The larger the depth, the more detailed the summary.
#   port get: Retrieves the model information.
#   port summary: Model summary.
# ---------- modelsummary: Python ----------
"""Provides a summary of the autoencoder model's architecture."""
# flake8: noqa
from scriptcontext import sticky as st

from aixd_ara.gh_ui import nn_summary
from aixd_ara.gh_ui_helper import component_id
from aixd_ara.gh_ui_helper import session_id

cid = component_id(session_id(), ghenv.Component, "ModelSummary")


if not max_depth:
    max_depth = 1

if get:
    st[cid] = nn_summary(session_id(), max_depth)

if cid in st.keys():
    summary = st[cid]["summary"]
# ---------- end modelsummary ----------
panel_10 = Panel(modelload)
panel_11 = Panel(modeldimensions)
panel_12 = Panel(modelsummary)
showfolder_2 = ShowFolder(path=modeltrain.path, open=Button())  # inputs open: Boolean; same code as showfolder

# ----
# Generative Design
request = Panel("""sundiff:-7
gfa:10000""")
generator = Generator(requested_values=request, n_designs="10", generate=Button(), clear=Button(), pick_previous=Button(), pick_next=Button())  # -> sample_summary; inputs requested_values: list, n_designs: Int32, generate: Boolean, clear: Boolean, pick_previous: Boolean, pick_next: Boolean
#   port requested_values: List of requested values, each formatted as a string with the following format: 'variable_name:value'.
# ---------- generator: Python ----------
# flake8: noqa

from scriptcontext import sticky as st

from aixd_ara.gh_ui import get_dataobject_types
from aixd_ara.gh_ui import request_designs
from aixd_ara.gh_ui_helper import component_id
from aixd_ara.gh_ui_helper import instantiate_sample
from aixd_ara.gh_ui_helper import sample_summary as sample_summary_f
from aixd_ara.gh_ui_helper import session_id
from aixd_ara.gh_ui_helper import reformat_request

cid = component_id(session_id(), ghenv.Component, "Generator")
item = component_id(session_id(), ghenv.Component, "GeneratorPickItem")

"""
requested_values: a multiline string with variable_name:values tuples.
"""

if not n_designs or n_designs < 1:
    n_designs = 1

# -------------------------------------------------------------------------------


if clear and cid in st.keys():
    del st[cid]
    st[item] = None
    ghenv.Component.Message = "no samples"

if generate and requested_values:

    variable_types = get_dataobject_types(session_id())["dataobject_types"]

    request_dict = reformat_request(requested_values, variable_types)
    st[item] = 0
    ghenv.Component.Message = "Running"
    st[cid] = request_designs(session_id(), request_dict, n_designs)
    ghenv.Component.Message = "Finished"

if pick_previous:
    st[item] -= 1
if pick_next:
    st[item] += 1

if cid in st.keys():
    samples = st[cid]["generated"]
    n = len(samples)
    i = st[item] % n

    ghenv.Component.Message = "sample {}/{}".format(i + 1, n)

    sample_dict = samples[i]
    ghdoc = ghenv.Component.OnPingDocument()
    instantiate_sample(ghdoc, sample_dict)  # sends design parameter values to the parametric model

    # --- output ---
    sample_summary = "Predicted/Generated:\n--------------------\n\n" + sample_summary_f(sample_dict)
# ---------- end generator ----------
panel_13 = Panel(generator)

mesh_2 = Mesh(brep)

# ----
# Context Geometry
terrain = Geometry([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])
context = Geometry([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])
facades_to_evaluate = Geometry([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])  # disabled
preview_3 = CustomPreview(Geometry=[terrain, context, facades_to_evaluate], Material=ColourSwatch(SwatchColor=RGB(199, 199, 199)))

# ----
# Sensitivity Analysis
target = Panel("sundiff")
sample = Panel("heights:[10,10,10,10,10,10,10,10]")
target_2 = Panel("sundiff")
plotlocalsensitivity = PlotLocalSensitivity(target_name=target, sample=sample, plot=Button())  # inputs sample: list, plot: Boolean
#   port target_name: Name of a target performance attribute.
#   port sample: List of design parameters for a single sample, each formatted as a string with the following format: 'variable_name:value'.
#   port plot: Set to True to calculate and plot the local sensitivity.
# ---------- plotlocalsensitivity: Python ----------
"""Calculates and plots the local sensitivity of a given target (performance attribute) w.r.t. a specific design (sample). 
Requires a dataset and a trained model to be loaded."""
from scriptcontext import sticky as st

from aixd_ara.gh_ui import local_sensitivity
from aixd_ara.gh_ui_helper import component_id
from aixd_ara.gh_ui_helper import session_id
from aixd_ara.gh_ui_helper import reformat_request
from aixd_ara.gh_ui import get_dataobject_types

cid = component_id(session_id(), ghenv.Component, "PlotLocalSensitivity")


if plot:
    variable_types = get_dataobject_types(session_id())["dataobject_types"]
    test_point = reformat_request(sample, variable_types)
    st[cid] = local_sensitivity(session_id(), test_point, target_name)  # will launch the plotly fig in browser

if cid in st.keys():
    print(st[cid])
# ---------- end plotlocalsensitivity ----------
plotglobalsensitivity = PlotGlobalSensitivity(target_name=target_2, set_name="train", n_samples="100", plot=Button())  # inputs n_samples: Int32, plot: Boolean
#   port target_name: Name of a target performance attribute.
#   port set_name: Name of the dataset-subset to be used ('train', 'val' or 'test'). Dafault: 'val'.
#   port n_samples: Number of samples to be drawn from the selected dataset-subset. Optional. If not provided, all samples from the selected dataset-subset are used.
#   port plot: Set to True to calculate and plot the local sensitivity.
# ---------- plotglobalsensitivity: Python ----------
"""Calculates and plots the global sensitivity of a given target (performance attribute) w.r.t. a batch of data samples. 
Requires a dataset and a trained model to be loaded. 
Global sensitivity can be slow to compute for large datasets, so it is recommended to subsample using `n_samples`."""
from scriptcontext import sticky as st

from aixd_ara.gh_ui import global_sensitivity
from aixd_ara.gh_ui_helper import component_id
from aixd_ara.gh_ui_helper import session_id

cid = component_id(session_id(), ghenv.Component, "PlotGlobalSensitivity")

if set_name is None: set_name = "val" # 'train','val' or 'test' 

if plot:
    st[cid] = global_sensitivity(session_id(),  target_name, set_name, n_samples)  # will launch the plotly fig in browser

if cid in st.keys():
    print(st[cid])
# ---------- end plotglobalsensitivity ----------

# ==== cluster Cluster

# ----
# INPUTS
# Design Parameters
# Design Constants
heights = ClusterInput()
outlines = ClusterInput()
other_buildings_brep = Brep([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])
srf_to_evaluate = Surface([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])
outlines_2 = Curve(outlines)
heights_2 = Number(heights)

Z = UnitZ(Factor=heights_2)
extr = Extrude(Base=outlines_2, Direction=Z)
cap = CapHoles(Brep=extr)
newtrotte_brep = Brep(cap)
contour = Contour(Shape=newtrotte_brep, Point=Point(2681534.993, 1250040.001, 438.7751663), Direction=Vector(0, 0, 1), Distance="3.5")  # -> simplify(Contours)
path_mapper = PathMapper(contour, source="{a;b}", target="{a}(b)")
lng = ListLength(List=simplify(path_mapper))  # -> expr("x-1", flatten(Length))
area = Area(Geometry=outlines_2)  # -> Area, Centroid
geo = Geometry(path_mapper)
multiplication = Multiplication(A=area.Area, B=lng)
item = ListItem(List=geo, Index=0, Wrap=True)
item_2 = ListItem(List=geo, Index=-1, Wrap=True)
ma = MassAddition(Input=multiplication)  # -> Result, PartialResults
loft = Loft(Curves=[item, item_2], Options={Adjust=False, Closed=False, LoftEnds=0, LoftSimp=0, LoftType=0, Rebuild=10, Refit=0.01})
cap_2 = CapHoles(Brep=loft)
building_breps = Brep(flatten(cap_2))
volume = Volume(Geometry=building_breps)  # -> Volume, Centroid
ma_2 = MassAddition(Input=flatten(volume.Volume))  # -> Result, PartialResults

# ---- group: Run Me!
toggle = BooleanToggle(True)

# ----
custom_mesh_settings = SettingsCustom(
    StitchSeams=True,
    SimplePlanes=False,
    Refine=True,
    MinCount=16,
    MaxCount=40,
    AspectRatio=1,
    MaxDistance=0,
    MaxAngle=20,
    MinEdge=0.5,
    MaxEdge=1)
mesh = MeshBrep(Brep=srf_to_evaluate, Settings=custom_mesh_settings)
mesh_2 = Mesh(mesh)
geo_to_analyse = Geometry(mesh_2)
vec = Vector([Vector(-0.7995586584, 0.5633378523, -0.2082220351), Vector(-0.4313448186, 0.8395146771, -0.3303887927), Vector(0.0282754144, 0.9572296825, -0.2879441542), Vector(0.4562412335, 0.8849464888, -0.09334692734), Vector(-0.8215798388, 0.5156068093, -0.2432204486), Vector(-0.4551775476, 0.8059508416, -0.3784925905)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])
geo_context = Geometry([other_buildings_brep, building_breps])
directsunhours = LBDirectSunHours(
    vectors=flatten(vec),
    geometry=flatten(geo_to_analyse),
    context=flatten(geo_context),
    grid_size="1",
    offset_dist="0.5",
    cpu_count=8,
    run=toggle)  # -> report, points, results, mesh, legend, title, int_mtx; plug-in component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
directsunhours_2 = LBDirectSunHours(
    vectors=flatten(vec),
    geometry=flatten(geo_to_analyse),
    context=flatten(other_buildings_brep),
    grid_size="1",
    offset_dist="0.5",
    run=Toggle(False))  # -> report, points, results, mesh, legend, title, int_mtx; disabled; plug-in component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
python = GhPythonScript(mesh=directsunhours.mesh)  # -> out, face_areas; inputs mesh: Mesh
# ---------- python: Python ----------
import Rhino

# Function to calculate the area of a triangle given its vertices
def triangle_area(a, b, c):
    ab = b - a
    ac = c - a
    cross_product = Rhino.Geometry.Vector3d.CrossProduct(ab, ac)
    return 0.5 * cross_product.Length

# Function to calculate the area of a quad given its vertices
def quad_area(vertices):
    # Split the quad into two triangles
    triangle1_area = triangle_area(vertices[0], vertices[1], vertices[2])
    triangle2_area = triangle_area(vertices[0], vertices[2], vertices[3])
    # Sum the areas of the triangles
    return triangle1_area + triangle2_area


# Get the mesh faces
mesh_faces = mesh.Faces

face_areas = []
# Iterate through each face and calculate its area
for i in range(mesh_faces.Count):
    face = mesh_faces[i]
    # Retrieve the vertices of the face
    vertices = [mesh.Vertices[j] for j in face]
    # Check if it's a quad or a triangle
    if len(vertices) == 4:
        face_area = quad_area(vertices)
    elif len(vertices) == 3:
        face_area = triangle_area(vertices[0], vertices[1], vertices[2])
    else:
        #print(f"Face {i+1} is neither a triangle nor a quad.")
        continue
    #print(f"Area of Face {i+1}: {face_area}")
    face_areas.append(face_area)
# ---------- end python ----------
num = Number([10, 10, 15, 10, 15, 15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])
lng_2 = ListLength(List=vec)
num_2 = Number(directsunhours.results)
pt = Point(directsunhours.points)
tag = TextTag(Location=pt, Text=num_2)  # disabled
python_2 = GhPythonScript(hours_new=flatten(num_2), hours_old=flatten(num), areas=flatten(python.face_areas), n_sun_vectors=lng_2)  # -> out, diff; inputs hours_new: list of Int32, hours_old: list of Int32, areas: list
# ---------- python_2: Python ----------
H = n_sun_vectors
A = sum(areas)
old = sum([h*a/A for h,a in zip(hours_old, areas)])/H
new = sum([h*a/A for h,a in zip(hours_new, areas)])/H

print old, new
diff = (new-old)*100
# ---------- end python_2 ----------

directsunhoursdifference = Number(python_2.diff)
floor_outlines = Curve(contour)
volume_m3 = Number(ma_2.Result)
mesh_3 = Mesh(directsunhours.mesh)
gfa_m2 = Number(ma.Result)

# ----
# OUTPUTS
# Geometry
# Performance Attributes
floor_outlines_2 = ClusterOutput(floor_outlines)
building_breps_2 = ClusterOutput(building_breps)
mesh_4 = ClusterOutput(mesh_3)
volume_m3_2 = ClusterOutput(volume_m3)
gfa_m2_2 = ClusterOutput(gfa_m2)
directsunhoursdifference_2 = ClusterOutput(directsunhoursdifference)
