# Grasshopper definition vase_xy.ghx (Grasshopper 1.0.7)
# plug-ins: ShapeDiverForGrasshopper

# Author: Aleksandra Anna Apolinarska (ETH Zurich, 2024)
# 
# See this example also using AIXD code here:
# https://gitlab.renkulab.io/ai-augmented-design/aixd/-/tree/master/examples/vase
sddp = ShapeDiverDocumentPayload({AbsoluteTolerance=0, AngleTolerance=0, DistanceDisplayPrecision=0, GltfVersion="Gltf2", GrasshopperVersion="1.0.0007", InputGroups="{}", OutputGroups="{}", RelativeTolerance=0, RhinoVersion="7.38.24338.17001", UnitSystem=0, VersionCreated="1.14.0.0", VersionSaved="1.14.0.0"})
ptx = GenePool(Decimals=6, Maximum=0.5, Minimum=0.1, Value=[0.1662731693, 0.2999647009, 0.251394083, 0.4176759338, 0.4384659789])
pty = GenePool(Decimals=6, Maximum=1, Minimum=0, Value=[0.2922538688, 0.5929997026, 0.3184375927, 0.008842761632, 0.2748637746])

# ----
# Project Setup
panel = Panel("")
server = Server(start=Button(), show_window=Toggle(True))  # -> msg; inputs start: Boolean, stop: Boolean, show_window: Boolean
#   port start: Starts the server.
# ---------- server: Python ----------
from __future__ import absolute_import
from __future__ import division
from __future__ import print_function

import urllib2

import compas
import compas._os
from ghpythonlib.componentbase import executingcomponent as component
from scriptcontext import sticky as st

from aixd_ara.constants import DEFAULT_PORT

try:
    from subprocess import PIPE
    from subprocess import Popen
except ImportError:
    from System.Diagnostics import Process

import os

import aixd_ara as ag


class ApiRunner(object):
    def __init__(
        self,
        package=None,
        python=None,
        url="http://127.0.0.1",
        port=DEFAULT_PORT,
        service=None,
        max_conn_attempts=100,
        autoreload=True,
        show_window=False,
        path=None,
        working_directory=None,
    ):
        self.python = compas._os.select_python(python)
        self.service = "aixd_ara.api"
        self.working_directory = working_directory
        self.show_window = show_window
        self.port = port

        self.start_process()

    def start_process(self):
        env = compas._os.prepare_environment()

        try:
            Popen
        except NameError:
            self._process = Process()
            for name in env:
                if self._process.StartInfo.EnvironmentVariables.ContainsKey(name):
                    self._process.StartInfo.EnvironmentVariables[name] = env[name]
                else:
                    self._process.StartInfo.EnvironmentVariables.Add(name, env[name])
            self._process.StartInfo.UseShellExecute = True
            self._process.StartInfo.RedirectStandardOutput = not self.show_window
            self._process.StartInfo.RedirectStandardError = not self.show_window
            self._process.StartInfo.FileName = self.python
            self._process.StartInfo.Arguments = "-m {0} {1}".format(self.service, self.port)
            self._process.Start()
        else:
            args = [self.python, "-m", self.service, str(self.port)]
            kwargs = dict(env=env)

            if self.show_window:
                if compas.is_mono():
                    python_command = " ".join(args)
                    apple_script = """
                    tell application "Terminal"
                        do script "{}"
                        activate
                    end tell
                    """.format(
                        python_command
                    )
                    args = ["osascript", "-e", apple_script]
            else:
                kwargs["stdout"] = PIPE
                kwargs["stderr"] = PIPE

            if self.working_directory:
                kwargs["cwd"] = self.working_directory
            self._process = Popen(args, **kwargs)

    def stop_process(self):
        """Attempts to terminate the python process hosting the proxy server.

        The process reference might not be present, e.g. in the case
        of reusing an existing connection. In that case, this is a no-op.
        """
        print("Stopping the server process.")

        if not self._process:
            return

        try:
            self._process.terminate()
        except Exception:
            pass
        try:
            self._process.kill()
        except Exception:
            pass


api_path = os.path.dirname(ag.__file__)

print(api_path)


def create_api_runner_id(component):
    name = "api-runner"
    return "{}_{}".format(name, component.InstanceGuid)


class ApiRunnerComponent(component):

    def RunScript(self, start, stop, show_window=True):
        key = create_api_runner_id(self)
        port = DEFAULT_PORT

        if show_window:
            python = "python"
        else:
            python = "pythonw"

        if start:
            self.stop(key)
            runner = ApiRunner(python=python, port=port, show_window=show_window, working_directory=api_path)
            st[key] = runner

        if stop:
            self.stop(key)

    def stop(self, key):
        # Attempt gracefully stopping the server
        try:
            urllib2.urlopen("http://127.0.0.1:8765/shutdown", timeout=1)
        except Exception:
            pass

        # stop previous API runner if any
        previous_api_runner = st.get(key)
        if previous_api_runner:
            try:
                previous_api_runner.stop_process()
            except Exception as e:
                print("Unable to stop previous process")
                print(e)
            st.pop(key)
        else:
            print("No previous process runner found")
# ---------- end server ----------
reset = Reset(reset=Button())  # inputs reset: Boolean
#   port reset: Set to True to reset.
# ---------- reset: Python ----------
"""Resets the current project running in this Grasshopper file."""
# flake8: noqa

from scriptcontext import sticky as st
from aixd_ara.gh_ui import reset_session
from aixd_ara.gh_ui_helper import session_id, clear_sticky

if reset:
    reset_session(session_id())
    clear_sticky(ghenv, st)
# ---------- end reset ----------
projectsetup = ProjectSetup(set=Button(), project_root=panel, project_name="vase_xy")  # -> msg, path; inputs set: Boolean
#   port project_root: Path to the project root folder. If none is given, the default is the parent folder of this Grasshopper file.
#   port project_name: Any name for the project. It will be used to create a folder with the same name in the project root folder. All files will be later saved here.
#   port msg: Messages and errors.
#   port path: Effective path to the project.
# ---------- projectsetup: Python ----------
"""Sets up the project in the folder given by `project_root/project_name`."""
# flake8: noqa
import os

from scriptcontext import sticky as st

from aixd_ara.gh_ui import project_setup
from aixd_ara.gh_ui_helper import clear_sticky
from aixd_ara.gh_ui_helper import component_id
from aixd_ara.gh_ui_helper import session_id

if not project_root:
    ghdoc = ghenv.Component.OnPingDocument().FilePath
    project_root = os.path.dirname(ghdoc)

if project_name:
    cid = component_id(session_id(), ghenv.Component, "ProjectSetup")

    if set:
        complete_path = os.path.join(project_root, project_name)
        if not os.path.exists(complete_path):
            print("The path {} does not exist and will be now created.".format(complete_path))
            os.mkdir(complete_path)

        clear_sticky(ghenv, st)

        st[cid] = project_setup(session_id(), project_root, project_name)

    if cid in st.keys():
        msg = st[cid]["msg"]
        path = st[cid]["path"]
# ---------- end projectsetup ----------
showfolder = ShowFolder(path=projectsetup.path, open=Button())  # inputs open: Boolean
#   port path: Path to the (local) folder.
#   port open: Set to True to open the folder in the file explorer.
# ---------- showfolder: Python ----------
"""Reveals the folder in the file explorer."""
# flake8: noqa

import os

if open:
    os.startfile(path)
# ---------- end showfolder ----------
panel_2 = Panel(projectsetup.path)
panel_3 = Panel(projectsetup.msg)

# ----
# Generate Samples
# Load Dataset
panel_4 = Panel("pty")
# Data
# Design Parameters
panel_5 = Panel("ptx")
# PerformanceAttributes
panel_6 = Panel("area")
load_dataset = Button()
datasetgenerator = DatasetGenerator()  # -> instructions
#   port instructions: Information on how to run the `dataset_generator` script.
# ---------- datasetgenerator: Python ----------
"""Provides instructions on how to generate random samples for the dataset."""
from aixd_ara.scripts import dataset_generator

path = dataset_generator.__file__

txt = "INSTRUCTIONS\n------------\n"
txt += "How to generate random samples for a dataset, by harnessing the parametric model defined in this Grasshopper file?\n\n"
txt += "Prepare the inputs and outputs to/from your parametric model as shown in the online documentation>tutorial at https://gramaziokohler.github.io/aixd_ara/latest/tutorial.html\n\n"
txt += "Close all other Grasshopper files in this Rhino app.\n\n"
txt += "Locate the 'dataset_generator.py' file in:\n\n"
txt += "\t{}\n\n".format(path)
txt += "In Rhino, open the Rhino Python Editor, open 'dataset_generator.py' and run it.\n"
txt += "(Follow the prompts in the Rhino command line)\n\n"

txt += "\n------------\n"
txt += "Optionally, add a button to a Rhino toolbar to access the dataset generator more easily:\n"
txt += "\t> right-click on a toolbar > New Button... \n"
txt += "\t> in the pop-up window, in Command section, paste:\n\n"
txt += "\t'! _-RunPythonScript {}'".format(path)

instructions = txt
# ---------- end datasetgenerator ----------
domain = Domain("0 to 1")
domain_2 = Domain("0.1 to 0.5")
datareal = DataReal(name=panel_4, dim="5", domain=domain)  # -> dataobject; inputs dim: Int32
#   port name: Name of the variable.
#   port dim: Dimension of the variable.
#   port domain: Domain of the variable as an interval.
# ---------- datareal: Python ----------
"""Defines a real-valued variable."""
# flake8: noqa
from aixd_ara.wrappers import WrapperShallowDataObject

if not dim or dim < 1:
    dim = 1

if domain:
    domain = (float(domain.Min), float(domain.Max))
else:
    domain = None


dobj = {"datatype": "DataReal", "name": name, "dim": dim, "domain": domain}


dataobject = WrapperShallowDataObject(dobj)
# ---------- end datareal ----------
datareal_2 = DataReal(name=panel_5, dim="5", domain=domain_2)  # -> dataobject; inputs dim: Int32; same code as datareal
datareal_3 = DataReal(name=panel_6)  # -> dataobject; inputs dim: Int32; same code as datareal
datareal_4 = DataReal(name="volume")  # -> dataobject; inputs dim: Int32; same code as datareal
datareal_5 = DataReal(name="height")  # -> dataobject; inputs dim: Int32; same code as datareal
datareal_6 = DataReal(name="width_mean")  # -> dataobject; inputs dim: Int32; same code as datareal
datareal_7 = DataReal(name="width_variance")  # -> dataobject; inputs dim: Int32; same code as datareal
datareal_8 = DataReal(name="length_max")  # -> dataobject; inputs dim: Int32; same code as datareal
datareal_9 = DataReal(name="tilt_max")  # -> dataobject; inputs dim: Int32; same code as datareal
datasetonesample = DatasetOneSample(get=Button())  # -> sample_summary; inputs item: Int32, get: Boolean
#   port item: Index of the sample in the dataset, optional. If not provided, a random index will be selected.
#   port get: Set to True to retrieve a sample.
#   port sample_summary: Summary of the retrieved sample.
# ---------- datasetonesample: Python ----------
"""Retrieves one sample from the dataset (at a given or random index) and instantiates it in the parametric model. 
Requires a dataset to be loaded."""
# flake8: noqa
from scriptcontext import sticky as st

from aixd_ara.gh_ui import get_one_sample
from aixd_ara.gh_ui_helper import component_id
from aixd_ara.gh_ui_helper import instantiate_sample, sample_summary
from aixd_ara.gh_ui_helper import session_id

cid = component_id(session_id(), ghenv.Component, "DatasetOneSample")


if not item:
    item = -1

if get:
    st[cid] = get_one_sample(session_id(), item)

ghdoc = ghenv.Component.OnPingDocument()


if cid in st.keys():
    sample = st[cid]
    instantiate_sample(ghdoc, sample)

    sample_summary = sample_summary(sample)
# ---------- end datasetonesample ----------
datasetload = DatasetLoad(load=load_dataset)  # -> msg; inputs load: Boolean
#   port load: Set to True to load the dataset.
# ---------- datasetload: Python ----------
"""Loads an existing dataset from the file system, from the location specified in the project setup. It loads the dataset object and the data into the app."""
# flake8: noqa
from scriptcontext import sticky as st

from aixd_ara.gh_ui import load_dataset
from aixd_ara.gh_ui_helper import component_id
from aixd_ara.gh_ui_helper import session_id

cid = component_id(session_id(), ghenv.Component, "DatasetLoad")

if load:
    st[cid] = load_dataset(session_id())

if cid in st.keys():
    msg = st[cid]["msg"]
# ---------- end datasetload ----------
datasetsummary = DatasetSummary(get=Button())  # -> summary; inputs get: Boolean
#   port get: Set to True to get the summary of the dataset.
#   port summary: Summary of the dataset.
# ---------- datasetsummary: Python ----------
"""Provides a summary of the dataset."""
# flake8: noqa
from scriptcontext import sticky as st

from aixd_ara.gh_ui import dataset_summary
from aixd_ara.gh_ui_helper import component_id
from aixd_ara.gh_ui_helper import session_id

cid = component_id(session_id(), ghenv.Component, "DatasetSummary")

if get:
    st[cid] = dataset_summary(session_id())

if cid in st.keys():
    if st[cid]["msg"]:
        summary = st[cid]["msg"]  # error
    else:
        summary = st[cid]["summary"]
# ---------- end datasetsummary ----------
panel_7 = Panel(datasetgenerator)
panel_8 = Panel(datasetsummary)
panel_9 = Panel(datasetonesample)
panel_10 = Panel(datasetload)
# Setup Dataset
datasetcreate = DatasetCreate(
    design_parameters=[datareal_2, datareal],
    performance_attributes=[datareal_3, datareal_4, datareal_5, datareal_6, datareal_7, datareal_8, datareal_9],
    create=Button())  # -> msg; inputs design_parameters: list, performance_attributes: list, create: Boolean
#   port design_parameters: Design parameters: list of data objects.
#   port performance_attributes: Performance attributes: list of data objects.
#   port create: Set to True to create a dataset object. If a dataset already exists in the project path, nothing will happen. To create a new dataset, change the project path or dataset name or delete the existing dataset.
#   port msg: Message or error.
# ---------- datasetcreate: Python ----------
"""Creates a dataset object. This defines the structure of the dataset. It does not cointain any data."""
# flake8: noqa
from scriptcontext import sticky as st
from Grasshopper.Kernel.GH_RuntimeMessageLevel import Warning

from aixd_ara.gh_ui import create_dataset_object
from aixd_ara.gh_ui_helper import component_id
from aixd_ara.gh_ui_helper import session_id

cid = component_id(session_id(), ghenv.Component, "DatasetCreate")


design_parameters = [x.data for x in design_parameters]
performance_attributes = [x.data for x in performance_attributes]


if create:
    st[cid] = create_dataset_object(session_id(), design_parameters, performance_attributes)

if cid in st.keys():
    msg = st[cid]["msg"]
    if st[cid]["status"]=="warning":
        ghenv.Component.AddRuntimeMessage(Warning, msg)
# ---------- end datasetcreate ----------

# ----
# Plotters
performance_attributes = Panel("""area
volume
height
width_mean
width_variance
length_max
tilt_max""")
plotcorrelations = PlotCorrelations(variables=performance_attributes, plot=Button())  # inputs variables: list, plot: Boolean
#   port variables: List of names of the variables to be plotted.
#   port plot: Set to True to (re-)create the plot.
# ---------- plotcorrelations: Python ----------
"""Plots correlation matrix for the given variables from the data in the dataset."""
# flake8: noqa
from scriptcontext import sticky as st

from aixd_ara.gh_ui import plot_correlations
from aixd_ara.gh_ui_helper import component_id
from aixd_ara.gh_ui_helper import convert_str_to_bitmap
from aixd_ara.gh_ui_helper import session_id

cid = component_id(session_id(), ghenv.Component, "PlotCorrelations")


if plot:
    st[cid] = plot_correlations(session_id(), variables, "interactive")  # will launch the plotly fig in browser

if cid in st.keys():
    print(st[cid])
# ---------- end plotcorrelations ----------
plotdistribution = PlotDistribution(variables=performance_attributes, plot=Button())  # inputs variables: list, plot: Boolean
#   port variables: List of names of the variables to be plotted.
#   port plot: Set to True to (re-)create the plot.
# ---------- plotdistribution: Python ----------
"""Plots the distribution of the given variables from the data in the dataset."""
# flake8: noqa
from scriptcontext import sticky as st

from aixd_ara.gh_ui import plot_distrib_attributes
from aixd_ara.gh_ui_helper import component_id
from aixd_ara.gh_ui_helper import convert_str_to_bitmap
from aixd_ara.gh_ui_helper import session_id

cid = component_id(session_id(), ghenv.Component, "PlotDistributions")


if plot:
    st[cid] = plot_distrib_attributes(session_id(), variables, "interactive") #  will launch the plotly fig in browser

if cid in st.keys():
    print(st[cid])
# ---------- end plotdistribution ----------
plotcontours = PlotContours(variables=performance_attributes, plot=Button())  # inputs variables: list, plot: Boolean
#   port variables: List of names of the variables to be plotted.
#   port plot: Set to True to (re-)create the plot.
# ---------- plotcontours: Python ----------
"""Plots the distribution contours for each pair of variables from the data in the dataset."""
# flake8: noqa
from scriptcontext import sticky as st

from aixd_ara.gh_ui import plot_contours
from aixd_ara.gh_ui_helper import component_id
from aixd_ara.gh_ui_helper import convert_str_to_bitmap
from aixd_ara.gh_ui_helper import session_id

cid = component_id(session_id(), ghenv.Component, "PlotContours")


if plot:
    st[cid] = plot_contours(session_id(), variables, "interactive") # will launch the plotly fig in browser

if cid in st.keys():
    print st[cid]
# ---------- end plotcontours ----------
plotcontoursrequest = PlotContoursRequest(plot=Button())  # inputs plot: Boolean
#   port plot: Set to True to (re-)create the plot.
# ---------- plotcontoursrequest: Python ----------
"""Plots the predicted values of the requested designs against the distribution contours for each pair of the corresponding variables."""
# flake8: noqa
from scriptcontext import sticky as st
from aixd_ara.gh_ui import plot_contours_request
from aixd_ara.gh_ui import get_dataobject_types
from aixd_ara.gh_ui_helper import session_id
from aixd_ara.gh_ui_helper import component_id
from aixd_ara.gh_ui_helper import convert_str_to_bitmap
from aixd_ara.gh_ui_helper import reformat_request


cid = component_id(session_id, ghenv.Component, "PlotContoursRequest")


if plot:
    st[cid] = plot_contours_request(session_id(), "interactive") # will launch the plotly fig in browser

if cid in st.keys():
    print st[cid]
# ---------- end plotcontoursrequest ----------

design_parameters = Panel("""ptx
pty""")
performance_attributes_2 = Panel("""area
volume
height
width_mean
width_variance
length_max
tilt_max""")

# ----
# Autoencoder Model
# set up a new model
# run training
# load a trained model
# model summary
number_slider = Slider(2, range=1..5)
load_model = Button()
train = Button()
panel_11 = Panel("""128
128
128""")
modelsetup = ModelSetup(
    features=design_parameters,
    targets=performance_attributes_2,
    latent_dim="4",
    hidden_layers=panel_11,
    batch_size="512",
    set=Button())  # -> quick_summary, model_dims; inputs features: list, targets: list, latent_dim: Int32, hidden_layers: list of Int32, batch_size: Int32, set: Boolean
#   port model_type: Type of the autoencoder model. Options are: 'CAE' (conditional Autoencoder) and 'CVAE' (conditional Variational Autoencoder). Default: 'CAE'.
#   port features: List of variable names to be used as input to the model.
#   port targets: List of variable names to be used as output from the model.
#   port latent_dim: Dimension of the latent space.
#   port hidden_layers: Width of each hidden layer (list of int).
#   port batch_size: Size of the training batches
#   port set: Set to True to set up the model.
#   port quick_summary: Quick summary of the model.
#   port model_dims: Input and output dimensions of the model.
# ---------- modelsetup: Python ----------
"""Sets up an autoencoder model of the specified type with the given parameters."""
# flake8: noqa
from scriptcontext import sticky as st

from aixd_ara.gh_ui import model_setup
from aixd_ara.gh_ui_helper import component_id
from aixd_ara.gh_ui_helper import session_id

cid = component_id(session_id(), ghenv.Component, "ModelSetup")

settings = {
    "model_type": model_type,
    "inputML": features,
    "outputML": targets,
    "latent_dim": latent_dim,
    "hidden_layers": hidden_layers,
    "batch_size": batch_size,
}


# TODO: make default settings a bit more smart
default_settings = {
    "model_type": "CAE",
    "inputML": "design_parameters",
    "outputML": "performance_attributes",
    "latent_dim": 8,
    "hidden_layers": [512, 256, 128, 64],
    "batch_size": 16,
}

for k in default_settings.keys():
    if (k not in settings) or (k in settings and settings[k] == None) or (k in settings and settings[k] == []):
        settings[k] = default_settings[k]
        print(k, default_settings[k])


if set:
    st[cid] = model_setup(session_id(), settings)


if cid in st.keys():
    quick_summary = st[cid]["quick_summary"]["summary"]
    model_dims = st[cid]["model_dims"]["summary"]
    ghenv.Component.Message = st[cid]["msg"]
# ---------- end modelsetup ----------
modeltrain = ModelTrain(epochs="100", run=train)  # -> best_ckpt, path; inputs epochs: Int32, run: Boolean
#   port epochs: Number of training epochs.
#   port wb: Weights&Biases: username or team name. If not set, W&B will not be used.
#   port run: Set to True to start training.
#   port best_ckpt: Filename of the best performing checkpoint.
#   port path: Path to all checkpoints.
# ---------- modeltrain: Python ----------
"""Runs a training campaign."""
# flake8: noqa

from scriptcontext import sticky as st

from aixd_ara.gh_ui import model_train
from aixd_ara.gh_ui import project_setup_info
from aixd_ara.gh_ui_helper import component_id
from aixd_ara.gh_ui_helper import session_id

cid = component_id(session_id(), ghenv.Component, "ModelTrain")


if not epochs or epochs < 1:
    epochs = 1

if wb:
    import webbrowser

    if run:
        projectname = project_setup_info(session_id())["project_name"]
        url = "https://wandb.ai/{}/{}".format(wb, projectname)
        webbrowser.open(url)
        # TODO: check login and add interface to login if needed


if run:
    st[cid] = model_train(session_id(), epochs, wb)


if cid in st.keys():
    best_ckpt = st[cid]["best_ckpt"]
    path = st[cid]["path"]
    ghenv.Component.Message = st[cid]["msg"]
else:
    ghenv.Component.Message = ""

# TODO:
# * return path or name of best checkpoint
# * make non-GUI-blocking
# * display progress
# ---------- end modeltrain ----------
modelload = ModelLoad(load=load_model)  # -> msg; inputs load: Boolean
#   port model_type: Type of the autoencoder model. Options are: 'CAE' (conditional Autoencoder) and 'CVAE' (conditional Variational Autoencoder). Default: 'CAE'.
#   port checkpoint_name: Name of the checkpoint file to load the model from, without the file extension. The file's extension must be .ckpt
#   port checkpoint_path: Path to the directory containing the checkpoint file.
#   port load: Set to True to load the model.
#   port msg: Confirmation of the model loading, or an error message.
# ---------- modelload: Python ----------
"""Loads an existing, pre-traind neural network model from a checkpoint."""
# flake8: noqa
from scriptcontext import sticky as st

from aixd_ara.gh_ui import model_load
from aixd_ara.gh_ui_helper import component_id
from aixd_ara.gh_ui_helper import session_id

cid = component_id(session_id(), ghenv.Component, "ModelLoad")

if not model_type:
    model_type = "CAE"
if not checkpoint_path:
    checkpoint_path = ""
if not checkpoint_name:
    checkpoint_name = "last"

if load:
    st[cid] = model_load(session_id(), model_type, checkpoint_name, checkpoint_path)

if cid in st.keys():
    msg = st[cid]["msg"]
# ---------- end modelload ----------
modeldimensions = ModelDimensions(get=Button())  # -> summary; inputs get: Boolean
#   port get: Set to True to retrieve input and output dimensions of the model.
#   port summary: Summary of the model's input and output dimensions.
# ---------- modeldimensions: Python ----------
"""Retrieves dimensions of the model's input and output layers."""
# flake8: noqa
from scriptcontext import sticky as st

from aixd_ara.gh_ui import model_input_output_dimensions
from aixd_ara.gh_ui_helper import component_id
from aixd_ara.gh_ui_helper import session_id

cid = component_id(session_id(), ghenv.Component, "ModelDims")

if get:
    st[cid] = model_input_output_dimensions(session_id())

if cid in st.keys():
    summary = st[cid]["summary"]
# ---------- end modeldimensions ----------
modelsummary = ModelSummary(max_depth=number_slider, get=Button())  # -> summary; inputs max_depth: Int32, get: Boolean
#   port max_depth: Sets the depth of the summary. The larger the depth, the more detailed the summary.
#   port get: Retrieves the model information.
#   port summary: Model summary.
# ---------- modelsummary: Python ----------
"""Provides a summary of the autoencoder model's architecture."""
# flake8: noqa
from scriptcontext import sticky as st

from aixd_ara.gh_ui import nn_summary
from aixd_ara.gh_ui_helper import component_id
from aixd_ara.gh_ui_helper import session_id

cid = component_id(session_id(), ghenv.Component, "ModelSummary")


if not max_depth:
    max_depth = 1

if get:
    st[cid] = nn_summary(session_id(), max_depth)

if cid in st.keys():
    summary = st[cid]["summary"]
# ---------- end modelsummary ----------
panel_12 = Panel(modelsummary)
panel_13 = Panel(modelload)
panel_14 = Panel(modeldimensions)
showfolder_2 = ShowFolder(path=modeltrain.path, open=Button())  # inputs open: Boolean
#   port path: Path to the (local) folder.
#   port open: Set to True to open the folder in the file explorer.
# ---------- showfolder_2: Python ----------
"""Reveals the folder in the file explorer."""
# flake8: noqa

import compas
import subprocess

if open:
    command = "open"
    if compas.is_windows():
        command = "explorer"

    subprocess.Popen([command, path])
# ---------- end showfolder_2 ----------

# ----
# Inverse Design
request = Panel("""volume:0.1
height:0.8""")
generator = Generator(requested_values=request, n_designs="10", generate=Button(), clear=Button(), pick_previous=Button(), pick_next=Button())  # -> sample_summary; inputs requested_values: list, n_designs: Int32, generate: Boolean, clear: Boolean, pick_previous: Boolean, pick_next: Boolean
#   port requested_values: List of requested values, each formatted as a string with the following format: 'variable_name:value'.
# ---------- generator: Python ----------
# flake8: noqa

from scriptcontext import sticky as st

from aixd_ara.gh_ui import get_dataobject_types
from aixd_ara.gh_ui import request_designs
from aixd_ara.gh_ui_helper import component_id
from aixd_ara.gh_ui_helper import instantiate_sample
from aixd_ara.gh_ui_helper import sample_summary as sample_summary_f
from aixd_ara.gh_ui_helper import session_id
from aixd_ara.gh_ui_helper import reformat_request

cid = component_id(session_id(), ghenv.Component, "Generator")
item = component_id(session_id(), ghenv.Component, "GeneratorPickItem")

"""
requested_values: a multiline string with variable_name:values tuples.
"""

if not n_designs or n_designs < 1:
    n_designs = 1

# -------------------------------------------------------------------------------


if clear and cid in st.keys():
    del st[cid]
    st[item] = None
    ghenv.Component.Message = "no samples"

if generate and requested_values:

    variable_types = get_dataobject_types(session_id())["dataobject_types"]

    request_dict = reformat_request(requested_values, variable_types)
    st[item] = 0
    ghenv.Component.Message = "Running"
    st[cid] = request_designs(session_id(), request_dict, n_designs)
    ghenv.Component.Message = "Finished"

if pick_previous:
    st[item] -= 1
if pick_next:
    st[item] += 1

if cid in st.keys():
    samples = st[cid]["generated"]
    n = len(samples)
    i = st[item] % n

    ghenv.Component.Message = "sample {}/{}".format(i + 1, n)

    sample_dict = samples[i]
    ghdoc = ghenv.Component.OnPingDocument()
    instantiate_sample(ghdoc, sample_dict)  # sends design parameter values to the parametric model

    # --- output ---
    sample_summary = "Predicted/Generated:\n--------------------\n\n" + sample_summary_f(sample_dict)
# ---------- end generator ----------
panel_15 = Panel(generator)

dp_pty = Number([0.1471467241, 0.8498326791, 0.1358939461, 0.7942022637, 0.09307355575])
panel_16 = Panel("vase_xy_CAE")
dp_ptx = Number([0.2320656641, 0.1929199318, 0.2389825434, 0.19250216, 0.2291374836])
cluster = Cluster(ptx=dp_ptx, pty=dp_pty)  # -> controlpts, profilecrv, vase3d, height, area_2, volume_2, width_mean, width_variance, length_max, tilt_max
pa_width_variance = Number(cluster.width_variance)
pa_width_mean = Number(cluster.width_mean)
pa_length_max = Number(cluster.length_max)
pa_volume = Number(cluster.volume_2)
pa_tilt_max = Number(cluster.tilt_max)
pa_height = Number(cluster.height)
pa_area = Number(cluster.area_2)
geometry = Geometry([cluster.profilecrv, cluster.controlpts])
brep = Brep(cluster.vase3d)

# ----
# Sensitivity Analysis
target = Panel("volume")
target_2 = Panel("volume")
sample = Panel("""ptx:[0.1,0.4,0.3,0.2,0.5]
pty:[0.0,0.2,0.4,0.6,1.0]""")
plotlocalsensitivity = PlotLocalSensitivity(target_name=target_2, sample=sample, plot=Button())  # inputs sample: list, plot: Boolean
#   port target_name: Name of a target performance attribute.
#   port sample: List of design parameters for a single sample, each formatted as a string with the following format: 'variable_name:value'.
#   port plot: Set to True to calculate and plot the local sensitivity.
# ---------- plotlocalsensitivity: Python ----------
"""Calculates and plots the local sensitivity of a given target (performance attribute) w.r.t. a specific design (sample). 
Requires a dataset and a trained model to be loaded."""
from scriptcontext import sticky as st

from aixd_ara.gh_ui import local_sensitivity
from aixd_ara.gh_ui_helper import component_id
from aixd_ara.gh_ui_helper import session_id
from aixd_ara.gh_ui_helper import reformat_request
from aixd_ara.gh_ui import get_dataobject_types

cid = component_id(session_id(), ghenv.Component, "PlotLocalSensitivity")


if plot:
    variable_types = get_dataobject_types(session_id())["dataobject_types"]
    test_point = reformat_request(sample, variable_types)
    st[cid] = local_sensitivity(session_id(), test_point, target_name)  # will launch the plotly fig in browser

if cid in st.keys():
    print(st[cid])
# ---------- end plotlocalsensitivity ----------
plotglobalsensitivity = PlotGlobalSensitivity(target_name=target, set_name="train", n_samples="100", plot=Button())  # inputs n_samples: Int32, plot: Boolean
#   port target_name: Name of a target performance attribute.
#   port set_name: Name of the dataset-subset to be used ('train', 'val' or 'test'). Dafault: 'val'.
#   port n_samples: Number of samples to be drawn from the selected dataset-subset. Optional. If not provided, all samples from the selected dataset-subset are used.
#   port plot: Set to True to calculate and plot the local sensitivity.
# ---------- plotglobalsensitivity: Python ----------
"""Calculates and plots the global sensitivity of a given target (performance attribute) w.r.t. a batch of data samples. 
Requires a dataset and a trained model to be loaded. 
Global sensitivity can be slow to compute for large datasets, so it is recommended to subsample using `n_samples`."""
from scriptcontext import sticky as st

from aixd_ara.gh_ui import global_sensitivity
from aixd_ara.gh_ui_helper import component_id
from aixd_ara.gh_ui_helper import session_id

cid = component_id(session_id(), ghenv.Component, "PlotGlobalSensitivity")

if set_name is None: set_name = "val" # 'train','val' or 'test' 

if plot:
    st[cid] = global_sensitivity(session_id(),  target_name, set_name, n_samples)  # will launch the plotly fig in browser

if cid in st.keys():
    print(st[cid])
# ---------- end plotglobalsensitivity ----------

custom_preview = CustomPreview(Geometry=geometry, Material=ColourSwatch(SwatchColor=RGB(0, 126, 204)))
custom_preview_2 = CustomPreview(Geometry=brep, Material=ColourSwatch(SwatchColor=RGB(204, 204, 204)))
dataobjectsnames = DataObjectsNames(get_names=Button())  # inputs get_names: Boolean
#   port get_names: Set to True to run.
# ---------- dataobjectsnames: Python ----------
"""Generates panels with list of names of data objects for all existing data blocks."""
# flake8: noqa

# this code has been inspired by a forum post by "chanley" (2018.11.02)
# https://discourse.mcneel.com/t/can-i-instantiate-specific-component-on-the-canvas-with-a-script-python/74204/8

import Grasshopper
import System.Drawing as sd

from aixd_ara.gh_ui import get_dataobject_names_from_block
from aixd_ara.gh_ui_helper import session_id

comp = ghenv.Component
ghdoc = comp.OnPingDocument()


def make_Panel(NickName, UserText, Pivot, Bounds):
    try:
        Panel = Grasshopper.Kernel.Special.GH_Panel()
        Panel.NickName = NickName
        Panel.UserText = UserText
        Panel.Properties.Colour = sd.Color.White
        # Panel.Properties.Font = sd.Font("Trebuchet MS", 10)
        Panel.Properties.Multiline = False
        Panel.Properties.DrawIndices = False
        Panel.Properties.DrawPaths = False
        ghdoc.AddObject(Panel, False, ghdoc.ObjectCount + 1)
        Panel.Attributes.Pivot = Pivot
        Panel.Attributes.Bounds = Bounds
    except Exception(ex):
        ghenv.Component.AddRuntimeMessage(Grasshopper.Kernel.GH_RuntimeMessageLevel.Warning, str(ex))


x = ghenv.Component.Attributes.DocObject.Attributes.Bounds.Right
y = ghenv.Component.Attributes.DocObject.Attributes.Bounds.Top

w = 150
h = 150
gap = 50

errors = ""

datablocks = ["design_parameters", "performance_attributes", "inputML", "outputML"]  # all datablock names

if get_names:

    for i, datablock_nickname in enumerate(datablocks):
        panel_title = datablock_nickname
        response = get_dataobject_names_from_block(session_id(), datablock_nickname)
        text_items = response["names"]
        if text_items:
            text_str = "\n".join(text_items)
            pt = sd.PointF(x + gap + i * gap, y + i * gap)
            rect = sd.RectangleF(0, 0, w, h)
            make_Panel(panel_title, text_str, pt, rect)
        else:
            errors += response["msg"] + "\n"

if errors:
    ghenv.Component.AddRuntimeMessage(Grasshopper.Kernel.GH_RuntimeMessageLevel.Warning, str(errors))
# ---------- end dataobjectsnames ----------

# ==== cluster Cluster
# Does not exactly match the pure-python version!
# * height - limit to last slice
# * area, volume - more accurate
# * tilt - more accurate
ptx = ClusterInput()
pty = ClusterInput()
ghpython_script = GhPythonScript(ptx=ptx, pty=pty)  # -> out, flatten(pts); inputs ptx: list, pty: list
# ---------- ghpython_script: Python ----------
def sort_control_points(pts):
    pts = [list(pt) for pt in pts]  # Ensure mutable copies of points
    pts.sort(key=lambda x: x[1])  # Sort by the second element (y-coordinate)
    zmin = min(pt[1] for pt in pts)  # Find the minimum y-coordinate
    for pt in pts:
        pt[1] -= zmin  # Adjust y-coordinates
    return pts
    

pts = zip(ptx,pty)

pts = sort_control_points(pts)


import Rhino.Geometry as rg
pts = [rg.Point3d(x,0,y) for x,y in pts]
# ---------- end ghpython_script ----------
colour_swatch = ColourSwatch(SwatchColor=RGB(255, 255, 255))  # disabled
ghpython_script_2 = GhPythonScript(pts=ghpython_script.pts)  # -> out, flatten(width_mean), flatten(width_variance), flatten(length_max), Bezier; inputs pts: list of Point3d
# ---------- ghpython_script_2: Python ----------
import Rhino.Geometry as rg
import math

def create_profile_curve(control_points, subsampling=100):
    """
    Samples a Bezier curve given by control points pts.
    Returns x and y coordinates of the sampled points in separate arrays.
    """
    s = subsampling  # subsampling, number of sample points +1

    cpx,cpy  = control_points
    spx = [__Bezier_t(cpx, t * 1 / s) for t in range(s)]
    spy = [__Bezier_t(cpy, t * 1 / s) for t in range(s)]

    return spx, spy

def __Bezier_t(pts, t):
    """
    Evaluates Bezier curve equation for a single coordinate at a single parameter value t
    """
    d = len(pts)
    n = d - 1
    return sum(
        #[math.comb(n, i) * (1 - t) ** (n - i) * t**i * pts[i] for i in range(d)]
        [math.factorial(n) // (math.factorial(i) * math.factorial(n - i)) * (1 - t) ** (n - i) * t**i * pts[i] for i in range(d)]
    )
    

#------------------------------------
# CURVE

control_points = [[p.X for p in pts],[p.Z for p in pts]]

spx, spy = create_profile_curve(control_points)

Bezier = rg.Polyline([rg.Point3d(x,0,z) for x,z in zip(spx,spy)]).ToNurbsCurve()

#------------------------------------
# ANALYSIS

n=len(spx)

width_mean = mean = sum(spx) / n

width_variance = sum((xi - width_mean) ** 2 for xi in spx) / n

height = max(spy)


rmax = max(spx)
length_max = 2 * math.pi * rmax
# ---------- end ghpython_script_2 ----------
nurbs_curve = NurbsCurve(Vertices=ghpython_script.pts, Degree=4, Periodic=False)  # -> Curve, Length, Domain

# ----
# Calculate max tilt (max angle to vertical)
# * using actual slices (using layer thickness)
# * from tangents at sampled points
layer_thickness = Panel("0.01 ")
series = Series(Start=0, Step=layer_thickness, Count=expr("101", 10))
contour_ex = ContourEx(Curve=nurbs_curve.Curve, Plane=PlaneXY(0, 0, 0), Offsets=series)  # -> flatten(Contours), Parameters
polyline = PolyLine(Vertices=contour_ex.Contours, Closed=False)
range = Range(Domain=Domain(0, 1), Steps=100)
explode = Explode(Curve=polyline, Recursive=True)  # -> Segments, Vertices
evaluate_curve = EvaluateCurve(Curve=reparameterize(nurbs_curve.Curve), Parameter=range)  # -> Point, Tangent, Angle
vector = Vector(explode.Segments)
angle = Angle(VectorA=evaluate_curve.Tangent, VectorB=Vector(0, 0, 1))  # -> Angle, Reflex
angle_2 = Angle(VectorA=vector, VectorB=Vector(0, 0, 1))  # -> Angle, Reflex
degrees = Degrees(Radians=angle.Angle)
degrees_2 = Degrees(Radians=angle_2.Angle)
min_max = MinMax(Number=degrees_2)  # -> Minimum, flatten(Maximum)
min_max_2 = MinMax(Number=degrees)  # -> Minimum, Maximum
panel = Panel(min_max.Maximum)
panel_2 = Panel(min_max_2.Maximum)

custom_preview = CustomPreview(Geometry=ghpython_script_2.Bezier, Material=colour_swatch)  # disabled
ghpython_script_3 = GhPythonScript(crv=nurbs_curve.Curve)  # -> out, crv; inputs crv: Curve
# ---------- ghpython_script_3: Python ----------
# add bottom

import Rhino.Geometry as rg


bottom = rg.Line(rg.Point3d(0,0,0), crv.PointAtStart).ToNurbsCurve()

crv_ = rg.NurbsCurve.JoinCurves([crv,bottom])
# ---------- end ghpython_script_3 ----------
revolution = Revolution(Curve=ghpython_script_3.crv, Axis=Line((0, 0, 0), (0, 0, 1)), Domain=Domain(0, 6.283185307))
cap_holes = CapHoles(Brep=revolution)
volume = Volume(Geometry=cap_holes)  # -> flatten(Volume), Centroid
area = Area(Geometry=revolution)  # -> flatten(Area), Centroid
ghpython_script_4 = GhPythonScript(pts=ghpython_script.pts)  # -> flatten(height); inputs pts: list of Point3d
# ---------- ghpython_script_4: Python ----------
height= pts[-1].Z
# ---------- end ghpython_script_4 ----------
controlpts = ClusterOutput(ghpython_script.pts)
profilecrv = ClusterOutput(nurbs_curve.Curve)
vase3d = ClusterOutput(revolution)
height = ClusterOutput(ghpython_script_4)
area_2 = ClusterOutput(area.Area)
volume_2 = ClusterOutput(volume.Volume)
width_mean = ClusterOutput(ghpython_script_2.width_mean)
width_variance = ClusterOutput(ghpython_script_2.width_variance)
length_max = ClusterOutput(ghpython_script_2.length_max)
tilt_max = ClusterOutput(min_max.Maximum)
